# Grasshopper definition test.gh (Grasshopper 1.0.7)
# plug-ins: EditableGeometry

crv = Curve(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)
mesh = Mesh(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)
sph = Sphere(Base=PlaneXY(0, 0, 0), Radius=Slider(25, range=0..100))
X = UnitX(Factor=Slider(165, range=0..200))
merge = Merge(Data1=sph, Data2=crv, Data3=mesh)
move = Move(Geometry=merge, Motion=X)  # -> graft(Geometry), Transform
edit = Edit(Geometry=move.Geometry, Flush=Button(), EditMode=False)
unflatten = UnflattenTree(Tree=edit, Guide=move.Geometry)
panel = Panel(edit)
